# Grasshopper definition generator_3.0.gh (Grasshopper 1.0.7)
# plug-ins: ClipperComponents, Telepathy, eleFront5, Pufferfish, treesloth01, Sasquatch, Flexibility, ShapeDiverForGrasshopper

panel = Panel("""45
70
95
120
145
170
195
220
245
295""")
plate_width = RemoteSender(Slider(1200, range=200..10000))
plate_height = RemoteSender(Slider(2400, range=200..10000))
nr_top_plates = RemoteSender(Slider(1, range=0..10))
nr_bottom_plates = RemoteSender(Slider(1, range=0..10))
noggings_distance = RemoteSender(Slider(0, range=0..1000))
cc = RemoteSender(Slider(600, range=0..1000))
roof_cc = RemoteSender(Slider(600, range=0..1000))
floor_cc = RemoteSender(Slider(600, range=0..1000))
header_toggle = RemoteSender(Toggle(True))
# TO DO
bake = RemoteSender(Button())
timber_thickness = RemoteSender(Slider(45, range=0..100))
# Add brandvæg support
timer_dims = RemoteSender(panel)
sddp = ShapeDiverDocumentPayload({AbsoluteTolerance=0, AngleTolerance=0, DistanceDisplayPrecision=0, GltfVersion="Gltf2", GrasshopperVersion="1.0.0007", InputGroups="{}", OutputGroups="{}", RelativeTolerance=0, RhinoVersion="7.38.24338.17001", UnitSystem=0, VersionCreated="1.20.0.0", VersionSaved="1.20.0.0"})
pipeline = GeometryPipeline(
    GroupByLayer=False,
    GroupByType=False,
    IncludeHidden=False,
    IncludeLocked=True,
    LayerFilter="Gluelam",
    NameFilter="*",
    SublayerFiltering=True,
    TypeFilter=1073741848)
reflay = ReferenceByLayer(LayerName="Footprint", lightweight=False, DisableAutoUpdate=False, OnlyVisible=True)
reflay_2 = ReferenceByLayer(LayerName="Floor", lightweight=False, DisableAutoUpdate=False, OnlyVisible=True)
issolid = BrepIsSolid(Brep=pipeline)
rh_footprint = RemoteSender(reflay)
cull = CullPattern(List=pipeline, CullPattern=issolid)
merge = Merge(Data1=reflay_2)
clean = CleanTree(RemoveNulls=True, RemoveInvalid=True, RemoveEmpty=True, Tree=cull)
clean_2 = CleanTree(RemoveNulls=True, RemoveInvalid=True, RemoveEmpty=True, Tree=merge)
shfdep = ShiftToDepth(Tree=pipeline, Depth="1", shiftFromStart=False)
shfdep_2 = ShiftToDepth(Tree=clean_2, Depth="1", shiftFromStart=False)
pipeline_2 = GeometryPipeline(
    GroupByLayer=False,
    GroupByType=False,
    IncludeHidden=True,
    IncludeLocked=True,
    LayerFilter="Walls",
    NameFilter="*",
    SublayerFiltering=True,
    TypeFilter=1073741848)
pipeline_3 = GeometryPipeline(
    GroupByLayer=False,
    GroupByType=False,
    IncludeHidden=True,
    IncludeLocked=True,
    LayerFilter="Windows",
    NameFilter="*",
    SublayerFiltering=True,
    TypeFilter=1073741848)
pipeline_4 = GeometryPipeline(
    GroupByLayer=False,
    GroupByType=False,
    IncludeHidden=True,
    IncludeLocked=True,
    LayerFilter="Roof",
    NameFilter="*",
    SublayerFiltering=True,
    TypeFilter=1073741848)
pipeline_5 = GeometryPipeline(
    GroupByLayer=False,
    GroupByType=False,
    IncludeHidden=True,
    IncludeLocked=True,
    LayerFilter="Doors",
    NameFilter="*",
    SublayerFiltering=True,
    TypeFilter=1073741848)
windowbreps = GetGeometry(AtLeast=1, AtMost=1, DeleteInput=False, Filter=1074081855, TreeAccess=False)
wallbreps = GetGeometry(AtLeast=1, AtMost=1, DeleteInput=False, Filter=1074081855, TreeAccess=False)
roofbreps = GetGeometry(AtLeast=1, AtMost=1, DeleteInput=False, Filter=1074081855, TreeAccess=False)
doorbreps = GetGeometry(AtLeast=1, AtMost=1, DeleteInput=False, Filter=1074081855, TreeAccess=False)
shfdep_3 = ShiftToDepth(Tree=[roofbreps, pipeline_4], Depth="1", shiftFromStart=False)
shfdep_4 = ShiftToDepth(Tree=[wallbreps, pipeline_2], Depth="1", shiftFromStart=False)
shfdep_5 = ShiftToDepth(Tree=[windowbreps, pipeline_3], Depth="1", shiftFromStart=False)
rh_gluelam = RemoteSender(shfdep)
rh_floors = RemoteSender(shfdep_2)
shfdep_6 = ShiftToDepth(Tree=[doorbreps, pipeline_5], Depth="1", shiftFromStart=False)
rh_roof = RemoteSender(shfdep_3)
rh_walls = RemoteSender(shfdep_4)
rh_windows = RemoteSender(shfdep_5)
rh_doors = RemoteSender(shfdep_6)
rh_footprint_2 = RemoteReceiver(rh_footprint)
lng = ListLength(List=rh_footprint_2)
equals = Equality(FirstNumber=lng, SecondNumber="0")  # -> Equality, Inequality
rh_gluelam_2 = RemoteReceiver(rh_gluelam)
# Building
rh_roof_2 = RemoteReceiver(rh_roof)
rh_floors_2 = RemoteReceiver(rh_floors)
graft = GraftTree(Tree=rh_roof_2, IncludeEmptyLists=True, IncludeNullItems=True)
graft_2 = GraftTree(Tree=rh_gluelam_2, IncludeEmptyLists=True, IncludeNullItems=True)
graft_3 = GraftTree(Tree=rh_floors_2, IncludeEmptyLists=True, IncludeNullItems=True)
# Kit
path_mapper = PathMapper(graft, source="{A;B}", target="{1;B}")
path_mapper_2 = PathMapper(graft_2, source="{A;B}", target="{3;B}")
path_mapper_3 = PathMapper(graft_3, source="{A;B}", target="{2;B}")
# Sub elem
roof_box = RemoteSender(path_mapper)
gluelam = RemoteSender(path_mapper_2)
floor_boxes = RemoteSender(path_mapper_3)
Z = UnitZ(Factor=Slider(-500, range=-500..0))
Z_2 = UnitZ(Factor=1)
pi = Pi(Factor="-0.5")
rh_walls_2 = RemoteReceiver(rh_walls)
timber_thickness_2 = RemoteReceiver(timber_thickness)
bbox = BoundingBox(Content=rh_walls_2, Plane=PlaneXY(0, 0, 0), UnionBox=True)  # -> Box, Box_2
cc_2 = RemoteReceiver(cc)
division = Division(A=timber_thickness_2, B="2")
debrep = DeconstructBrep(Brep=bbox.Box)  # -> Faces, Edges, Vertices
path = FilePath("C:\GH_components\EndDetailer.py")
sort_pt = SortPoints(Points=debrep.Vertices)  # -> Points, Indices
addition = Addition(A=cc_2, B=division)
vec = VectorXYZ(XComponent=addition, YComponent=addition, ZComponent=0)  # -> Vector, Length
item = ListItem(List=sort_pt.Points, Index=0, Wrap=True)
move = Move(Geometry=item, Motion=vec.Vector)  # -> Geometry, Transform
ccpt = RemoteSender(move.Geometry)
panel_2 = Panel("""1
1
0""")
number_slider = Slider(0, range=0..1)
roof_cc_2 = RemoteReceiver(roof_cc)
roof_edge_beam = RemoteSender(Toggle(False))
timber_thickness_3 = RemoteReceiver(timber_thickness)
floor_cc_2 = RemoteReceiver(floor_cc)
timber_thickness_4 = RemoteReceiver(timber_thickness)
floor_boxes_2 = RemoteReceiver(floor_boxes)
roof_box_2 = RemoteReceiver(roof_box)
roof_edge_beam_2 = RemoteReceiver(roof_edge_beam)
ccpt_2 = RemoteReceiver(ccpt)
ccpt_3 = RemoteReceiver(ccpt)
path_2 = FilePath("C:\GH_components\Roofer.py")
path_3 = FilePath("C:\GH_components\Floorer.py")
floorer = GhPythonScript(Code=path_3, B=floor_boxes_2, T=timber_thickness_3, CC=floor_cc_2, P0=ccpt_3, EC=Slider(2, range=0..10))  # -> Out, J
roofer = GhPythonScript(Code=path_2, B=roof_box_2, T=timber_thickness_4, CC=roof_cc_2, P0=ccpt_2, EB=roof_edge_beam_2)  # -> Out, R
noggings_distance_2 = RemoteReceiver(noggings_distance)
geo = Geometry()
ccpt_4 = RemoteReceiver(ccpt)
header_toggle_2 = RemoteReceiver(header_toggle)
header_toggle_3 = RemoteReceiver(header_toggle)
header_toggle_4 = RemoteReceiver(header_toggle)
path_4 = FilePath("C:\GH_components\Collider.py")
path_5 = FilePath("C:\GH_components\FabProcessor.py")
path_6 = FilePath("C:\GH_components\WallAnalyzer.py")
path_7 = FilePath("C:\GH_components\Extruder.py")
path_8 = FilePath("C:\GH_components\PostProcessor3D.py")
gluelam_2 = RemoteReceiver(gluelam)
path_9 = FilePath("C:\GH_components\CrossSectionFilter.py")
timer_dims_2 = RemoteReceiver(timer_dims)
panel_3 = Panel(timer_dims_2)
path_10 = FilePath("C:\GH_components\LengthLister.py")
path_11 = FilePath("C:\GH_components\Previewer.py")
bake_2 = RemoteReceiver(bake)
refbake = ReferenceByBakeName(BakeName="bake", Key="*", Val="*", lightweight=False)
detatt = DetachAttributes(Geometry=refbake)  # -> Geometry, Attributes
ef_att = EleFrontAttributes(Attributes=detatt.Attributes, maintainBakeName=False)  # -> Attributes, Keys, Values, Name, Layer, ColourSource, DisplayColour, MaterialSource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
make_unique_names = GhPythonScript(x=ef_att.Name)  # -> out, a, b; inputs x: list
# ---------- make_unique_names: Python ----------
from collections import Counter

totals = Counter(x)
counts = {}
a = []
b = []
for i, name in enumerate(x):
    if totals[name] > 1:
        counts[name] = counts.get(name, 0) + 1
        a.append("{}_{}".format(name, counts[name]))
        b.append(i)
    else:
        a.append(name)
# ---------- end make_unique_names ----------
ef_att_2 = EleFrontAttributes(Attributes=ef_att.Attributes, Name=make_unique_names.a, maintainBakeName=False)  # -> Attributes, Keys, Values, Name, Layer, ColourSource, DisplayColour, MaterialSource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
bake_3 = BakeObjects(Geometry=detatt.Geometry, Attributes=ef_att_2.Attributes, BakeName="bake", Bake=False, createGroups=False)  # -> Message, Ghosts

# ----
# Make house footprint
rh_walls_3 = RemoteReceiver(rh_walls)
debrep_2 = DeconstructBrep(Brep=rh_walls_3)  # -> Faces, Edges, Vertices
evalsrf = EvaluateSurface(Surface=reparameterize(debrep_2.Faces), Point=Point(0.5, 0.5, 0))  # -> Point, Normal, UDirection, VDirection, Frame
Z_3 = UnitZ(Factor=1)
angle = Angle(VectorA=evalsrf.Normal, VectorB=Z_3)  # -> Angle, Reflex
equals_2 = Equality(FirstNumber=angle.Angle, SecondNumber="0")  # -> Equality, Inequality
equals_3 = Equality(FirstNumber=angle.Angle, SecondNumber="pi")  # -> Equality, Inequality
or = GateOr(A=equals_2.Equality, B=equals_3.Equality)
cull_2 = CullPattern(List=debrep_2.Faces, CullPattern=or)
# ORGANIZE MAIN GEOMETRY
area = Area(Geometry=cull_2)  # -> Area, Centroid
pdecon = Deconstruct(Point=area.Centroid)  # -> XComponent, YComponent, ZComponent
sort = SortList(Keys=pdecon.ZComponent, ValuesA=cull_2)  # -> Keys, ValuesA
item_2 = ListItem(List=sort.ValuesA, Index=0, Wrap=True)
crv = Curve(item_2)
project = Project(Geometry=crv, Plane=PlaneXY(0, 0, 0))  # -> Geometry, Transform
offset = OffsetCurve(Curve=project.Geometry, Distance=10, Corners=1)
number_slider_2 = Slider(300, range=-1000..1000)
xy = XYPlane(Origin=Point(0, 0, 0))
xy_2 = XYPlane(Origin=Point(0, 0, 0))

shfdep_7 = ShiftToDepth(Tree=offset, Depth=1, shiftFromStart=False)

runion = RegionUnion(Curves=shfdep_7)
polyoffset = PolylineOffset(Polylines=runion, Distance=number_slider_2, Plane=xy, Tolerance=1e-05, ClosedFillet=2, OpenFillet=1, Miter=2)  # -> Contour, Holes
data = Data(polyoffset.Contour)
polyoffset_2 = PolylineOffset(Polylines=data, Distance=number_slider_2, Plane=xy_2, Tolerance=1e-05, ClosedFillet=2, OpenFillet=1, Miter=2)  # -> Contour, Holes
shfdep_8 = ShiftToDepth(Tree=polyoffset_2.Holes, Depth="1", shiftFromStart=False)
footprint = RemoteSender(runion)

filter = StreamFilter(Gate=equals.Inequality, Stream0=shfdep_8, Stream1=rh_footprint_2)
area_2 = Area(Geometry=filter)  # -> Area, Centroid
sort_2 = SortList(Keys=area_2.Area, ValuesA=filter)  # -> Keys, ValuesA
# {A;B;C}
item_3 = ListItem(List=reverse(sort_2.ValuesA), Index=0, Wrap=True)

silhuette = RemoteSender(item_3)

# ----
# Sort and name walls/kits
silhuette_2 = RemoteReceiver(silhuette)
rh_walls_4 = RemoteReceiver(rh_walls)
volume = Volume(Geometry=rh_walls_4)  # -> Volume, Centroid
crv_cp = CurveClosestPoint(Point=volume.Centroid, Curve=silhuette_2)  # -> Point, Parameter, Distance
sort_3 = SortList(Keys=crv_cp.Parameter, ValuesA=rh_walls_4)  # -> Keys, ValuesA
shfdep_9 = ShiftToDepth(Tree=sort_3.ValuesA, Depth="1", shiftFromStart=False)
graft_4 = GraftTree(Tree=shfdep_9, IncludeEmptyLists=True, IncludeNullItems=True)
cull_3 = CullPattern(List=graft_4, CullPattern=Toggle(False))
kit_tree_structure = RemoteSender(cull_3)
walls = RemoteSender(graft_4)

rhatt = GetRhinoAttributes(Geometry=sort_3.ValuesA, fullpath=False)  # -> Name, Layer, Color, MaterialName, SourceFile
mergeallrfaces = MergeAllCoplanarFaces(Geometry=sort_3.ValuesA, MeshToSubd=False)
shfdep_10 = ShiftToDepth(Tree=rhatt.Name, Depth="1", shiftFromStart=False)
graft_5 = GraftTree(Tree=shfdep_10, IncludeEmptyLists=True, IncludeNullItems=True)
wall_names = RemoteSender(graft_5)
walls_2 = RemoteReceiver(walls)
shfdep_11 = ShiftToDepth(Tree=walls_2, Depth="1", shiftFromStart=False)
volume_2 = Volume(Geometry=walls_2)  # -> Volume, Centroid
lng_2 = ListLength(List=shfdep_11)
series = Series(Start=0, Step=1, Count=lng_2)

# ----
# Define wall exposure attribute
walls_3 = RemoteReceiver(walls)
silhuette_3 = RemoteReceiver(silhuette)
shfdep_12 = ShiftToDepth(Tree=walls_3, Depth="1", shiftFromStart=False)
volume_3 = Volume(Geometry=shfdep_12)  # -> Volume, Centroid
project_2 = Project(Geometry=volume_3.Centroid, Plane=PlaneXY(0, 0, 0))  # -> Geometry, Transform
crv_cp_2 = CurveClosestPoint(Point=project_2.Geometry, Curve=silhuette_3)  # -> Point, Parameter, Distance
smaller = SmallerThan(FirstNumber=crv_cp_2.Distance, SecondNumber=Slider(500, range=0..1000))  # -> SmallerThan, OrEqualTo
shfdep_13 = ShiftToDepth(Tree=smaller.OrEqualTo, Depth="1", shiftFromStart=False)
lng_3 = ListLength(List=shfdep_13)
sift = SiftPattern(List=shfdep_12, SiftPattern=shfdep_13)  # -> graft(Output0), graft(Output1)
invbool = InvertBoolean(Boolean=shfdep_13)  # -> Inverted, Number
repeat = RepeatData(Data="interior", Length=lng_3)
repeat_2 = RepeatData(Data="exterior", Length=lng_3)
sift_2 = SiftPattern(List=repeat, SiftPattern=shfdep_13)  # -> Output0, Output1
sift_3 = SiftPattern(List=repeat_2, SiftPattern=invbool.Inverted)  # -> Output0, Output1
combine = CombineData(Input0=sift_2.Output0, Input1=sift_3.Output0)  # -> Result, Index
shfdep_14 = ShiftToDepth(Tree=combine.Result, Depth="1", shiftFromStart=False)  # -> graft(ShiftedTree)
wall_exposure_list = RemoteSender(shfdep_14)
interior_walls = RemoteSender(sift.Output0)
exterior_walls = RemoteSender(sift.Output1)

# ----
# Assign doors to walls
rh_doors_2 = RemoteReceiver(rh_doors)
walls_4 = RemoteReceiver(walls)
shfdep_15 = ShiftToDepth(Tree=walls_4, Depth="1", shiftFromStart=False)
shfdep_16 = ShiftToDepth(Tree=rh_doors_2, Depth="1", shiftFromStart=False)
crossref = CrossReference(ListA=shfdep_16, ListB=shfdep_15, CrossMode=1)  # -> ListA, ListB
colom = CollisionOneMany(Collider=graft(crossref.ListB), Obstacles=graft(crossref.ListA))  # -> Collision, Index
shfdep_17 = ShiftToDepth(Tree=crossref.ListA, Depth="1", shiftFromStart=False)
lng_4 = ListLength(List=shfdep_16)
shfdep_18 = ShiftToDepth(Tree=colom.Collision, Depth="1", shiftFromStart=False)
partition = PartitionList(List=shfdep_18, Size=lng_4)
partition_2 = PartitionList(List=shfdep_17, Size=lng_4)
cull_4 = CullPattern(List=partition_2, CullPattern=partition)
doors = RemoteSender(cull_4)

shfdep_19 = ShiftToDepth(Tree=series, Depth="1", shiftFromStart=False)

rh_windows_2 = RemoteReceiver(rh_windows)
# Assign windows to walls
walls_5 = RemoteReceiver(walls)
shfdep_20 = ShiftToDepth(Tree=walls_5, Depth="1", shiftFromStart=False)
shfdep_21 = ShiftToDepth(Tree=rh_windows_2, Depth="1", shiftFromStart=False)
crossref_2 = CrossReference(ListA=shfdep_21, ListB=shfdep_20, CrossMode=1)  # -> ListA, ListB
colom_2 = CollisionOneMany(Collider=graft(crossref_2.ListB), Obstacles=graft(crossref_2.ListA))  # -> Collision, Index
shfdep_22 = ShiftToDepth(Tree=crossref_2.ListA, Depth="1", shiftFromStart=False)
shfdep_23 = ShiftToDepth(Tree=colom_2.Collision, Depth="1", shiftFromStart=False)
lng_5 = ListLength(List=shfdep_21)
partition_3 = PartitionList(List=shfdep_23, Size=lng_5)
partition_4 = PartitionList(List=shfdep_22, Size=lng_5)
cull_5 = CullPattern(List=partition_4, CullPattern=partition_3)
windows = RemoteSender(cull_5)

concat = Concatenate(FragmentA="K", FragmentB=shfdep_19)  # -> graft(Result)
tag = TextTag(Location=volume_2.Centroid, Text=concat, Colour="white")
walls_6 = RemoteReceiver(walls)
shfdep_24 = ShiftToDepth(Tree=walls_6, Depth="1", shiftFromStart=False)
volume_4 = Volume(Geometry=walls_6)  # -> Volume, Centroid
lng_6 = ListLength(List=shfdep_24)
series_2 = Series(Start=0, Step=1, Count=lng_6)
wall_exposure_list_2 = RemoteReceiver(wall_exposure_list)
move_2 = Move(Geometry=volume_4.Centroid, Motion=Z)  # -> Geometry, Transform
shfdep_25 = ShiftToDepth(Tree=series_2, Depth="1", shiftFromStart=False)
concat_2 = Concatenate(FragmentA="K", FragmentB=shfdep_25)  # -> graft(Result)
tag_2 = TextTag(Location=move_2.Geometry, Text=wall_exposure_list_2, Colour="white")
silhuette_4 = RemoteReceiver(silhuette)
# EXTRACT LYSNINGER AND DOOR FRAMES
silhuette_5 = RemoteReceiver(silhuette)
silhuette_6 = RemoteReceiver(silhuette)
wall_names_2 = RemoteReceiver(wall_names)
kit_tree_structure_2 = RemoteReceiver(kit_tree_structure)
kit_tree_structure_3 = RemoteReceiver(kit_tree_structure)
kit_tree_structure_4 = RemoteReceiver(kit_tree_structure)
append_element = AppendElement(Data=kit_tree_structure_2, Index="0")
append_element_2 = AppendElement(Data=kit_tree_structure_3, Index="0")
append_element_3 = AppendElement(Data=kit_tree_structure_4, Index="0")
walls_7 = RemoteReceiver(walls)
wallanalyzer = GhPythonScript(Code=path_6, W=walls_7)  # -> Out, T, FR

# ----
# Find Kit Neighbors
number_of_walls_supported = Slider(1000, range=0..1000)
walls_8 = RemoteReceiver(walls)
shfdep_26 = ShiftToDepth(Tree=walls_8, Depth="1", shiftFromStart=False)
sqr = Square(Value=number_of_walls_supported)
kit_tree_structure_5 = RemoteReceiver(kit_tree_structure)

lng_7 = ListLength(List=shfdep_26)
tstat = TreeStatistics(Tree=shfdep_26)  # -> graft(Paths), Length, Count
tstat_2 = TreeStatistics(Tree=walls_8)  # -> Paths, Length, Count
repeat_3 = RepeatData(Data=tstat.Paths, Length=lng_7)  # -> simplify(graft(Data))
clone = CloneStructure(List=tstat_2.Paths, Structure=walls_8)
get_branch = GhPythonScript(T=shfdep_26, P=repeat_3)  # -> out, B; inputs T: tree, P: tree
# ---------- get_branch: Python ----------
"""
Inputs:
    T - DataTree to look up from
    P - DataTree of text paths to look up
Output:
    B - DataTree of items matching the path references
"""

from Grasshopper import DataTree
from Grasshopper.Kernel.Data import GH_Path

B = DataTree[object]()

for i in range(P.BranchCount):
    out_path = P.Path(i)
    branch = P.Branch(i)
    
    for text_path in branch:
        s = str(text_path).strip().strip("{}")
        
        if ";" in s:
            indices = [int(p.strip()) for p in s.split(";")]
        else:
            indices = [int(s)]
        
        lookup_path = GH_Path(*indices)
        
        if T.PathExists(lookup_path):
            for item in T.Branch(lookup_path):
                B.Add(item, out_path)
# ---------- end get_branch ----------
shfdep_27 = ShiftToDepth(Tree=clone, Depth="1", shiftFromStart=False)
get_branch_2 = GhPythonScript(T=shfdep_27, P=repeat_3)  # -> out, B; inputs T: tree, P: tree; same code as get_branch

clash = Clash(FirstSet=walls_8, SecondSet=get_branch.B, Distance=Slider(10, range=0..10), L=sqr)  # -> ClashCount, ClashPoints, ClashRadii, FirstIndex, SecondIndex

shfdep_28 = ShiftToDepth(Tree=clash.SecondIndex, Depth="2", shiftFromStart=False)
item_4 = ListItem(List=get_branch_2.B, Index=shfdep_28, Wrap=True)

txt = Text(item_4)
remove_self = GhPythonScript(x=txt)  # -> out, a; inputs x: tree
# ---------- remove_self: Python ----------
from Grasshopper import DataTree
from Grasshopper.Kernel.Data import GH_Path

a = DataTree[object]()

for path in x.Paths:
    path_str = "{" + ";".join(str(i) for i in path.Indices) + "}"
    branch = [item for item in x.Branch(path) if item != path_str]
    a.AddRange(branch, path)
# ---------- end remove_self ----------
match = MatchTree(Tree=remove_self.a, Guide=kit_tree_structure_5)
kit_neighbors = RemoteSender(match)

walls_9 = RemoteReceiver(walls)
windows_2 = RemoteReceiver(windows)
crossref_3 = CrossReference(ListA=windows_2, ListB=walls_9, CrossMode=1)  # -> ListA, ListB
sint = SolidIntersection(BrepsA=crossref_3.ListA, BrepsB=crossref_3.ListB)
debrep_3 = DeconstructBrep(Brep=sint)  # -> Faces, Edges, Vertices
area_3 = Area(Geometry=debrep_3.Faces)  # -> Area, Centroid
sort_4 = SortList(Keys=area_3.Area, ValuesA=debrep_3.Faces)  # -> Keys, reverse(ValuesA)
cull_i = CullIndex(List=sort_4.ValuesA, Indices=["0", "1"], Wrap=True)
shfdep_29 = ShiftToDepth(Tree=cull_i, Depth="3", shiftFromStart=False)
panel_4 = Panel("{building;kit;window}")
lysninger = RemoteSender(shfdep_29)

panel_5 = Panel([crossref_3.ListA, crossref_3.ListB])
item_5 = ListItem(List=sort_4.ValuesA, Index=["0", "1"], Wrap=True)
tstat_3 = TreeStatistics(Tree=panel_5)  # -> Paths, Length, Count
panel_6 = Panel([tstat_3.Paths, tstat_3.Length])
item_6 = ListItem(List=item_5, Index="0", Wrap=True)
panel_7 = Panel(item_5)
context_bake = ContextBake(WindowPane=item_6)
context_print = ContextPrint(Print=panel_6)
shfdep_30 = ShiftToDepth(Tree=item_6, Depth="2", shiftFromStart=False)

# ---- group: split lysninger
lysninger_2 = RemoteReceiver(lysninger)
plate_height_2 = RemoteReceiver(plate_height)
graft_6 = GraftTree(Tree=lysninger_2, IncludeEmptyLists=True, IncludeNullItems=True)
edges = BrepEdges(Brep=graft_6)  # -> Naked, Interior, NonManifold
item_7 = ListItem(List=edges.Naked, Index=0, Wrap=True)  # -> Item1, Item
divdist = DivideDistance(Curve=[item_7.Item1, item_7.Item], Distance=plate_height_2)  # -> Points, Tangents, Parameters
trim = TrimTree(Tree=divdist.Points, Depth=1)
srf_cp = SurfaceClosestPoint(Point=trim, Surface=graft_6)  # -> Point, UVPoint, Distance
shfdep_31 = ShiftToDepth(Tree=srf_cp.UVPoint, Depth=Slider(4, range=0..10), shiftFromStart=False)
iso = IsoCurve(Surface=graft_6, UVPoint=shfdep_31)  # -> UIsocurve, VIsocurve
relay = Relay([iso.UIsocurve, iso.VIsocurve])
shfdep_32 = ShiftToDepth(Tree=relay, Depth=Slider(4, range=0..10), shiftFromStart=False)
srfsplit = SurfaceSplit(Surface=graft_6, Curves=shfdep_32)
shfdep_33 = ShiftToDepth(Tree=srfsplit, Depth=Slider(3, range=0..10), shiftFromStart=False)
lysninger_trimmed_to_platesize = RemoteSender(shfdep_33)

# ----
walls_10 = RemoteReceiver(walls)
debrep_4 = DeconstructBrep(Brep=walls_10)  # -> Faces, Edges, Vertices
shfdep_34 = ShiftToDepth(Tree=debrep_4.Faces, Depth="2", shiftFromStart=False)
evalsrf_2 = EvaluateSurface(Surface=shfdep_34, Point="0,0")  # -> Point, unitize(Normal), UDirection, VDirection, Frame
abs = Absolute(Value=evalsrf_2.Normal)
devec = DeconstructVector(Vector=abs)  # -> XComponent, YComponent, ZComponent

smaller_2 = SmallerThan(FirstNumber=devec.ZComponent, SecondNumber="0.1")  # -> SmallerThan, OrEqualTo

cull_6 = CullPattern(List=shfdep_34, CullPattern=smaller_2.SmallerThan)

all_vertical_faces = RemoteSender(cull_6)

area_4 = Area(Geometry=cull_6)  # -> Area, Centroid
sort_5 = SortList(Keys=area_4.Area, ValuesA=cull_6)  # -> Keys, ValuesA
item_8 = ListItem(List=reverse(sort_5.ValuesA), Index=0, Wrap=True)  # -> Item, Item1
merge_2 = Merge(Data1=item_8.Item, Data2=item_8.Item1)

walls_11 = RemoteReceiver(walls)
doors_2 = RemoteReceiver(doors)
crossref_4 = CrossReference(ListA=doors_2, ListB=walls_11, CrossMode=1)  # -> ListA, ListB
sint_2 = SolidIntersection(BrepsA=crossref_4.ListA, BrepsB=crossref_4.ListB)
debrep_5 = DeconstructBrep(Brep=sint_2)  # -> Faces, Edges, Vertices
area_5 = Area(Geometry=debrep_5.Faces)  # -> Area, Centroid
sort_6 = SortList(Keys=area_5.Area, ValuesA=debrep_5.Faces)  # -> Keys, reverse(ValuesA)
cull_i_2 = CullIndex(List=sort_6.ValuesA, Indices=["0", "1"], Wrap=True)

area_6 = Area(Geometry=cull_i_2)  # -> Area, Centroid
item_9 = ListItem(List=sort_6.ValuesA, Index=["0", "1"], Wrap=True)
pdecon_2 = Deconstruct(Point=area_6.Centroid)  # -> XComponent, YComponent, ZComponent
sort_7 = SortList(Keys=pdecon_2.ZComponent, ValuesA=cull_i_2)  # -> Keys, ValuesA
item_10 = ListItem(List=item_9, Index=0, Wrap=True)  # -> Item, Item1
cull_i_3 = CullIndex(List=sort_7.ValuesA, Indices="0", Wrap=True)
shfdep_35 = ShiftToDepth(Tree=item_10.Item, Depth="2", shiftFromStart=False)

shfdep_36 = ShiftToDepth(Tree=cull_i_3, Depth="3", shiftFromStart=False)
door_frames = RemoteSender(shfdep_36)

# ---- group: split door frames
door_frames_2 = RemoteReceiver(door_frames)
plate_height_3 = RemoteReceiver(plate_height)
graft_7 = GraftTree(Tree=door_frames_2, IncludeEmptyLists=True, IncludeNullItems=True)
edges_2 = BrepEdges(Brep=graft_7)  # -> Naked, Interior, NonManifold
item_11 = ListItem(List=edges_2.Naked, Index=0, Wrap=True)  # -> Item1, Item
divdist_2 = DivideDistance(Curve=[item_11.Item1, item_11.Item], Distance=plate_height_3)  # -> Points, Tangents, Parameters
trim_2 = TrimTree(Tree=divdist_2.Points, Depth=1)
srf_cp_2 = SurfaceClosestPoint(Point=trim_2, Surface=graft_7)  # -> Point, UVPoint, Distance
shfdep_37 = ShiftToDepth(Tree=srf_cp_2.UVPoint, Depth=Slider(4, range=0..10), shiftFromStart=False)
iso_2 = IsoCurve(Surface=graft_7, UVPoint=shfdep_37)  # -> UIsocurve, VIsocurve
relay_2 = Relay([iso_2.UIsocurve, iso_2.VIsocurve])
shfdep_38 = ShiftToDepth(Tree=relay_2, Depth=Slider(4, range=0..10), shiftFromStart=False)
srfsplit_2 = SurfaceSplit(Surface=graft_7, Curves=shfdep_38)
shfdep_39 = ShiftToDepth(Tree=srfsplit_2, Depth=Slider(3, range=0..10), shiftFromStart=False)
lysninger_trimmed_to_platesize_2 = RemoteSender(shfdep_39)

# ----
shfdep_40 = ShiftToDepth(Tree=walls_10, Depth="1", shiftFromStart=False)
# EXTRACT WALL FACES
area_7 = Area(Geometry=merge_2)  # -> Area, Centroid
lng_8 = ListLength(List=shfdep_40)
repeat_4 = RepeatData(Data=silhuette_6, Length=lng_8)
shfdep_41 = ShiftToDepth(Tree=repeat_4, Depth="1", shiftFromStart=False)  # -> graft(ShiftedTree)
crv_cp_3 = CurveClosestPoint(Point=area_7.Centroid, Curve=shfdep_41)  # -> Point, Parameter, Distance
dist = Distance(PointA=crv_cp_3.Point, PointB=area_7.Centroid)
sort_8 = SortList(Keys=dist, ValuesA=merge_2)  # -> Keys, ValuesA
area_8 = Area(Geometry=sort_8.ValuesA)  # -> Area, Centroid
item_12 = ListItem(List=area_8.Centroid, Index=0, Wrap=True)  # -> Item, Item1
srf_cp_3 = SurfaceClosestPoint(Point=area_8.Centroid, Surface=sort_8.ValuesA)  # -> Point, UVPoint, Distance
dist_2 = Distance(PointA=item_12.Item, PointB=item_12.Item1)
evalsrf_3 = EvaluateSurface(Surface=sort_8.ValuesA, Point=srf_cp_3.UVPoint)  # -> Point, Normal, UDirection, VDirection, Frame
# {A;B;C}
wall_faces_outer_inner = RemoteSender(sort_8.ValuesA)

align = AlignPlane(Plane=evalsrf_3.Frame, Direction=Z_2)  # -> Plane, Angle
addition_2 = Addition(A=dist_2, B="0.1")
prot = RotatePlane(Plane=align.Plane, Angle=pi)
round = Round(Number=addition_2)  # -> Nearest, Floor, Ceiling

int = Integer(round.Floor)
wall_thicknesses = RemoteSender(int)
wall_frames = RemoteSender(prot)

wall_frames_2 = RemoteReceiver(wall_frames)
wall_frames_3 = RemoteReceiver(wall_frames)
item_13 = ListItem(List=wall_frames_2, Index=0, Wrap=True)
item_14 = ListItem(List=wall_frames_3, Index=0, Wrap=True)
project_3 = Project(Geometry=shfdep_35, Plane=item_13)  # -> Geometry, Transform
project_4 = Project(Geometry=shfdep_30, Plane=item_14)  # -> Geometry, Transform

door_pane = RemoteSender(project_3.Geometry)

window_pane = RemoteSender(project_4.Geometry)

windows_3 = RemoteReceiver(windows)
doors_3 = RemoteReceiver(doors)
item_15 = ListItem(List=sort_8.ValuesA, Index=0, Wrap=True)  # -> Item, Item1
merge_3 = Merge(Data1=windows_3, Data2=doors_3)
trim_3 = TrimSolid(Shape=item_15.Item, Cutters=merge_3)
trim_4 = TrimSolid(Shape=item_15.Item1, Cutters=merge_3)
python = GhPythonScript(x=[trim_3, trim_4])  # -> out, flatten(a)
# ---------- python: Python ----------
"""Has Data
Checks if input has any actual data.
"""
a = not ghenv.Component.Params.Input[0].VolatileData.IsEmpty
# ---------- end python ----------
merge_4 = Merge(Data1=trim_3, Data2=trim_4)
cset = CreateSet(List=python.a)  # -> Set, Map
shfdep_42 = ShiftToDepth(Tree=merge_4, Depth="2", shiftFromStart=False)
filter_2 = StreamFilter(Gate=cset.Set, Stream0=sort_8.ValuesA, Stream1=shfdep_42)
faces_with_openings = RemoteSender(filter_2)

kit_neighbors_2 = RemoteReceiver(kit_neighbors)
walls_12 = RemoteReceiver(walls)
get_branch_3 = GhPythonScript(T=walls_12, P=kit_neighbors_2)  # -> out, B; inputs T: tree, P: tree; same code as get_branch
item_16 = ListItem(List=sort_8.ValuesA, Index=0, Wrap=True)  # -> Item, Item1
graft_8 = GraftTree(Tree=sort_8.ValuesA, IncludeEmptyLists=True, IncludeNullItems=True)
trim_5 = TrimSolid(Shape=item_16.Item, Cutters=get_branch_3.B)
trim_6 = TrimSolid(Shape=item_16.Item1, Cutters=get_branch_3.B)
python_2 = GhPythonScript(x=get_branch_3.B)  # -> out, flatten(a); same code as python
path_mapper_4 = PathMapper(trim_6, source="{A;B;C}", target="{A;B;1}")
cset_2 = CreateSet(List=python_2.a)  # -> Set, Map
merge_5 = Merge(Data1=trim_5, Data2=path_mapper_4)
filter_3 = StreamFilter(Gate=cset_2.Set, Stream0=graft_8, Stream1=merge_5)
shfdep_43 = ShiftToDepth(Tree=filter_3, Depth="3", shiftFromStart=False)
wall_faces_no_cutouts = RemoteSender(shfdep_43)

kit_neighbors_3 = RemoteReceiver(kit_neighbors)
walls_13 = RemoteReceiver(walls)
get_branch_4 = GhPythonScript(T=walls_13, P=kit_neighbors_3)  # -> out, B; inputs T: tree, P: tree; same code as get_branch
item_17 = ListItem(List=filter_2, Index=0, Wrap=True)  # -> Item, Item1
# {A;B;C}
graft_9 = GraftTree(Tree=filter_2, IncludeEmptyLists=True, IncludeNullItems=True)
trim_7 = TrimSolid(Shape=item_17.Item, Cutters=get_branch_4.B)
trim_8 = TrimSolid(Shape=item_17.Item1, Cutters=get_branch_4.B)
python_3 = GhPythonScript(x=get_branch_4.B)  # -> out, flatten(a); same code as python
path_mapper_5 = PathMapper(trim_8, source="{A;B;C}", target="{A;B;1}")
cset_3 = CreateSet(List=python_3.a)  # -> Set, Map
merge_6 = Merge(Data1=trim_7, Data2=path_mapper_5)
filter_4 = StreamFilter(Gate=cset_3.Set, Stream0=graft_9, Stream1=merge_6)
shfdep_44 = ShiftToDepth(Tree=filter_4, Depth="3", shiftFromStart=False)
wall_faces = RemoteSender(shfdep_44)

wall_faces_no_cutouts_2 = RemoteReceiver(wall_faces_no_cutouts)
wall_faces_outer_inner_2 = RemoteReceiver(wall_faces_outer_inner)
split = SplitTree(Data=wall_faces_no_cutouts_2, Masks=flatten("{?;?;0}"))  # -> Positive, Negative
item_18 = ListItem(List=wall_faces_outer_inner_2, Index=0, Wrap=True)
edges_3 = BrepEdges(Brep=item_18)  # -> Naked, Interior, NonManifold
edges_4 = BrepEdges(Brep=split.Negative)  # -> Naked, Interior, NonManifold
edges_5 = BrepEdges(Brep=split.Positive)  # -> Naked, Interior, NonManifold
join = JoinCurves(Curves=edges_3.Naked, Preserve=False)
join_2 = JoinCurves(Curves=edges_4.Naked, Preserve=False)
join_3 = JoinCurves(Curves=edges_5.Naked, Preserve=False)
shfdep_45 = ShiftToDepth(Tree=join, Depth="3", shiftFromStart=False)
shfdep_46 = ShiftToDepth(Tree=join_2, Depth="3", shiftFromStart=False)
shfdep_47 = ShiftToDepth(Tree=join_3, Depth="3", shiftFromStart=False)
enddetailor = GhPythonScript(Code=path, P=shfdep_45, FF=shfdep_47, BF=shfdep_46)  # -> Out, Studs
panel_9 = Panel(enddetailor.Studs)

# ----
# Wall Framer
wall_faces_outer_inner_3 = RemoteReceiver(wall_faces_outer_inner)
nr_bottom_plates_2 = RemoteReceiver(nr_bottom_plates)
timber_thickness_5 = RemoteReceiver(timber_thickness)
nr_top_plates_2 = RemoteReceiver(nr_top_plates)
cc_3 = RemoteReceiver(cc)
item_19 = ListItem(List=wall_faces_outer_inner_3, Index=0, Wrap=True)
edges_6 = BrepEdges(Brep=item_19)  # -> Naked, Interior, NonManifold
join_4 = JoinCurves(Curves=edges_6.Naked, Preserve=False)
shfdep_48 = ShiftToDepth(Tree=join_4, Depth="3", shiftFromStart=False)
path_12 = FilePath("C:\GH_components\WallFramer.py")
wallframer = GhPythonScript(
    Code=path_12,
    P=shfdep_48,
    T=timber_thickness_5,
    CC=cc_3,
    TC=nr_top_plates_2,
    BC=nr_bottom_plates_2,
    N=wall_names_2,
    NG=noggings_distance_2,
    P0=ccpt_4)  # -> Out, TP, BP, NO, S

wall_thicknesses_2 = RemoteReceiver(wall_thicknesses)

# ----
# Door Framer
wall_faces_outer_inner_4 = RemoteReceiver(wall_faces_outer_inner)
door_pane_2 = RemoteReceiver(door_pane)
item_20 = ListItem(List=wall_faces_outer_inner_4, Index=0, Wrap=True)
edges_7 = BrepEdges(Brep=item_20)  # -> Naked, Interior, NonManifold
join_5 = JoinCurves(Curves=edges_7.Naked, Preserve=False)
shfdep_49 = ShiftToDepth(Tree=join_5, Depth="2", shiftFromStart=False)
edges_8 = BrepEdges(Brep=door_pane_2)  # -> Naked, Interior, NonManifold
join_6 = JoinCurves(Curves=edges_8.Naked, Preserve=False)
path_13 = FilePath("C:\GH_components\DoorFramer.py")
shfdep_50 = ShiftToDepth(Tree=join_6, Depth="2", shiftFromStart=False)
doorframer = GhPythonScript(Code=path_13, P=shfdep_49, D=shfdep_50, T=wall_thicknesses_2, S=wallframer.S, V=header_toggle_2)  # -> Out, ST, H, VH
door_stud = Relay([doorframer.ST, append_element])
door_header = Relay([doorframer.H, append_element])

wall_thicknesses_3 = RemoteReceiver(wall_thicknesses)
window_pane_2 = RemoteReceiver(window_pane)

# ----
# Door Framer
wall_faces_outer_inner_5 = RemoteReceiver(wall_faces_outer_inner)
item_21 = ListItem(List=wall_faces_outer_inner_5, Index=0, Wrap=True)
edges_9 = BrepEdges(Brep=item_21)  # -> Naked, Interior, NonManifold
join_7 = JoinCurves(Curves=edges_9.Naked, Preserve=False)
shfdep_51 = ShiftToDepth(Tree=join_7, Depth="2", shiftFromStart=False)
edges_10 = BrepEdges(Brep=window_pane_2)  # -> Naked, Interior, NonManifold
join_8 = JoinCurves(Curves=edges_10.Naked, Preserve=False)
path_14 = FilePath("C:\GH_components\DoorFramer.py")
shfdep_52 = ShiftToDepth(Tree=join_8, Depth="2", shiftFromStart=False)
doorframer_2 = GhPythonScript(Code=path_14, P=shfdep_51, D=shfdep_52, T=wall_thicknesses_3, S=wallframer.S, V=header_toggle_3)  # -> Out, ST, H, VH
door_stud_2 = Relay([doorframer_2.ST, append_element_3])
door_header_2 = Relay([doorframer_2.H, append_element_3])

wall_thicknesses_4 = RemoteReceiver(wall_thicknesses)

# ----
# window frame
wall_faces_outer_inner_6 = RemoteReceiver(wall_faces_outer_inner)
window_pane_3 = RemoteReceiver(window_pane)
item_22 = ListItem(List=wall_faces_outer_inner_6, Index=0, Wrap=True)
edges_11 = BrepEdges(Brep=window_pane_3)  # -> Naked, Interior, NonManifold
edges_12 = BrepEdges(Brep=item_22)  # -> Naked, Interior, NonManifold
join_9 = JoinCurves(Curves=edges_11.Naked, Preserve=False)
join_10 = JoinCurves(Curves=edges_12.Naked, Preserve=False)
shfdep_53 = ShiftToDepth(Tree=join_9, Depth="2", shiftFromStart=False)
shfdep_54 = ShiftToDepth(Tree=join_10, Depth="3", shiftFromStart=False)
path_15 = FilePath("C:\GH_components\WindowFramer.py")
windowframer = GhPythonScript(Code=path_15, P=shfdep_54, W=shfdep_53, T=wall_thicknesses_4, S=wallframer.S, V=header_toggle_4)  # -> Out, ST, H, VH, SL
window_header = Relay([windowframer.H, append_element_2])
window_sill = Relay([windowframer.SL, append_element_2])

window_stud = Relay([windowframer.ST, append_element_2])
windows_vertical_header = Relay([windowframer.VH, append_element_2])
door_vertical_header = Relay([doorframer.VH, append_element])
door_vertical_header_2 = Relay([doorframer_2.VH, append_element_3])
door_pane_3 = RemoteReceiver(door_pane)
# Top and Bottom Plates
wall_faces_outer_inner_7 = RemoteReceiver(wall_faces_outer_inner)
window_pane_4 = RemoteReceiver(window_pane)
item_23 = ListItem(List=wall_faces_outer_inner_7, Index=0, Wrap=True)
edges_13 = BrepEdges(Brep=item_23)  # -> Naked, Interior, NonManifold
edges_14 = BrepEdges(Brep=door_pane_3)  # -> Naked, Interior, NonManifold
edges_15 = BrepEdges(Brep=window_pane_4)  # -> Naked, Interior, NonManifold
join_11 = JoinCurves(Curves=edges_13.Naked, Preserve=False)
join_12 = JoinCurves(Curves=edges_14.Naked, Preserve=False)
join_13 = JoinCurves(Curves=edges_15.Naked, Preserve=False)
# Collider
shfdep_55 = ShiftToDepth(Tree=join_11, Depth="2", shiftFromStart=False)
shfdep_56 = ShiftToDepth(Tree=join_12, Depth="2", shiftFromStart=False)
shfdep_57 = ShiftToDepth(Tree=join_13, Depth="2", shiftFromStart=False)
shfdep_58 = ShiftToDepth(Tree=window_sill, Depth="2", shiftFromStart=False)
shfdep_59 = ShiftToDepth(Tree=door_header, Depth="2", shiftFromStart=False)
shfdep_60 = ShiftToDepth(Tree=door_vertical_header, Depth="2", shiftFromStart=False)
shfdep_61 = ShiftToDepth(Tree=window_header, Depth="2", shiftFromStart=False)
shfdep_62 = ShiftToDepth(Tree=door_stud, Depth="2", shiftFromStart=False)
shfdep_63 = ShiftToDepth(Tree=windows_vertical_header, Depth="2", shiftFromStart=False)
shfdep_64 = ShiftToDepth(Tree=wallframer.NO, Depth="2", shiftFromStart=False)
shfdep_65 = ShiftToDepth(Tree=window_stud, Depth="2", shiftFromStart=False)
shfdep_66 = ShiftToDepth(Tree=wallframer.TP, Depth="2", shiftFromStart=False)
shfdep_67 = ShiftToDepth(Tree=wallframer.S, Depth="2", shiftFromStart=False)
shfdep_68 = ShiftToDepth(Tree=wallframer.BP, Depth="2", shiftFromStart=False)
geo_2 = Geometry(shfdep_64)
collider = GhPythonScript(
    Code=path_4,
    P=shfdep_55,
    W=shfdep_57,
    D=shfdep_56,
    WS=shfdep_67,
    TP=shfdep_66,
    BP=shfdep_68,
    WKS=shfdep_65,
    DKS=shfdep_62,
    WH=shfdep_61,
    VH=shfdep_63,
    DH=shfdep_59,
    DVH=shfdep_60,
    SL=shfdep_58,
    NO=shfdep_64)  # -> Out, OWS, OWKS, ODKS, OWH, ODH, ODVH, OSL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
_2dfabprocessor = GhPythonScript(Code=path_5, F=collider.F, L=Slider(3980, range=0..10000), ND=Slider(5, range=0..10))  # -> Out, F
wall_thicknesses_5 = RemoteReceiver(wall_thicknesses)
wall_frames_4 = RemoteReceiver(wall_frames)
item_24 = ListItem(List=wall_frames_4, Index=0, Wrap=True)
extruder = GhPythonScript(Code=path_7, F=_2dfabprocessor.F, T=wall_thicknesses_5, FR=item_24)  # -> Out, G
relay_3 = Relay([extruder.G, roofer.R, floorer.J])
postprocessor3d = GhPythonScript(Code=path_8, G=relay_3, ML=Slider(5800, range=0..10000))  # -> Out, G
box = Box(postprocessor3d.G)
relay_4 = Relay([postprocessor3d.G, gluelam_2])
group_to_cross_section = GhPythonScript(Code=path_9, G=postprocessor3d.G, TD=timer_dims_2, T=Slider(1, range=0..10))  # -> Out, G, D
branch = TreeBranch(Tree=group_to_cross_section.G, Path=Slider(1, range=0..10), MaintainPaths=True)
length_lister = GhPythonScript(Code=path_10, G=group_to_cross_section.G, TD=timer_dims_2)  # -> Out, L

# ---- group: wall_namer
path_16 = FilePath("C:\GH_components\Namer.py")
namer = GhPythonScript(Code=path_16, F=relay_4)  # -> Out, N, L, C

# ----
brep = Brep(relay_4)
ma = MassAddition(Input=length_lister.L)  # -> Result, PartialResults
lng_9 = ListLength(List=length_lister.L)
cross_sec_out = Text(group_to_cross_section.D)
division_2 = Division(A=ma.Result, B=Slider(1000, range=0..1000))
panel_10 = Panel(cross_sec_out)
roundd = RoundToDecimalPlace(NumberX=division_2, DecimalPlace=Slider(1, range=0..1), RoundType=0)  # -> Rounded, Difference
previewer = GhPythonScript(Code=path_11, F=brep, M=Slider(2, range=0..2))  # -> Out, G, CO
count_out = Integer(lng_9)
total_length_out = Number(roundd.Rounded)
brep_2 = Brep(previewer.G)
material = CreateMaterial(Diffuse=previewer.CO, Specular=previewer.CO, Emission=previewer.CO, Transparency=Slider(0, range=0..1), Shine=0)
panel_11 = Panel(count_out)
panel_12 = Panel(total_length_out)
mesh = Mesh(brep_2)
preview = CustomPreview(Geometry=mesh, Material=material)

# ---- group: bake
ef_layer = EleFrontLayer(Layer=namer.L, DisplayColour=namer.C, fullpath=True)  # -> Layer, LayerNames, Hidden, Locked, DisplayColour, MaterialName, Linetype, PrintColour, PrintWidth
ef_att_3 = EleFrontAttributes(Name=namer.N, Layer=ef_layer.Layer, maintainBakeName=False)  # -> Attributes, Keys, Values, Name, Layer, ColourSource, DisplayColour, MaterialSource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
bake_4 = BakeObjects(Geometry=relay_4, Attributes=ef_att_3.Attributes, BakeName="bake", Bake=bake_2, createGroups=False)  # -> Message, Ghosts

# ----
c_bake = ContextBake(Content=simplify(flatten(mesh)))
c_bake_2 = ContextBake(Content=simplify(flatten(brep)))
