# Grasshopper definition test_simple.gh (Grasshopper 1.0.8)

wallbreps = GetGeometry(AnnotationTypeFilter=0, AtLeast=1, AtMost=1, DeleteInput=False, Filter=1074081855, TreeAccess=False)
X = UnitX(Factor=1)
contour = Contour(Shape=wallbreps, Point=Point(0, 0, 0), Direction=X, Distance=Slider(600, range=0..1000))
amp = Amplitude(Vector=X, Amplitude=Slider(100, range=0..100))
extr = Extrude(Base=contour, Direction=amp)
cap = CapHoles(Brep=extr)  # -> flatten(Brep)
mesh = Mesh(cap)
c_bake = ContextBake(Content=mesh)
c_bake_2 = ContextBake(Content=cap)
